# Grasshopper definition ZOOCAD.gh (Grasshopper 1.0.8)
# plug-ins: RhinoCodePluginGH

# Design a 30x30x30 box with a bebel of two cm on the sides a 2mm shell in one of the faces
panel = Panel("Design a flower")  # disabled
file_path = FilePath("/Users/jorgemuyo/Desktop/STUFF/AI_3D_Models_Grasshopper/")  # disabled
panel_2 = Panel("bd6b055b-416b-442b-a6c3-82435c74c684")  # disabled
# Design a 30x30x30 box with a bebel of two cm on the sides a 2mm shell in one of the faces
file_path_2 = FilePath("/Users/jorgemuyo/Desktop/STUFF/AI_3D_Models_Grasshopper/")
# PROMPT WRITING TIPS:
# 	•	Describe an object that can be represented in geometric shapes, not nebulous concepts such as "a tiger" or "the universe", unless you're just curious what it does with that 😏
# 	•	Be as explicit as possible. For example, if you want a plate with 4 holes, say where you want the holes placed and how big of a diameter each should have
# 	•	Our ML models are better at describing single objects than assemblies for now
panel_3 = Panel("bd6b055b-416b-442b-a6c3-82435c74c684")
panel_4 = Panel("Design a 10x20x40 box with a pattern extruded in the y axis")
boolean_toggle = BooleanToggle(True)  # disabled
button = Button()  # disabled
python_3_script = Python3Script(api=panel_2, path=file_path, prompt=panel, generate=boolean_toggle)  # -> out, output_file_path; disabled
# ---------- python_3_script: Python ----------
import time
import os

from kittycad.api.ai import create_text_to_cad, get_text_to_cad_model_for_user
from kittycad.client import Client
from kittycad.models.api_call_status import ApiCallStatus
from kittycad.models.file_export_format import FileExportFormat
from kittycad.models.text_to_cad_create_body import TextToCadCreateBody

# Set your API key directly in the code
API_KEY = api

# Create the client with the provided API key
client = Client(token=API_KEY)

# Define the output directory
output_dir = path

# Ensure the output directory exists
os.makedirs(output_dir, exist_ok=True)

# Set the variable 'a' to determine the output format
a = 2  # Change this value to 1, 2, or 3 to get .stl, .step, or .obj respectively

# Set the variable 'run_code' to control whether the script should run
run_code = generate  # Change this to False to skip running the script

if run_code:
    # Determine the output format based on the value of 'a'
    if a == 1:
        output_format = FileExportFormat.STL
        file_extension = "stl"
    elif a == 2:
        output_format = FileExportFormat.STEP
        file_extension = "step"
    elif a == 3:
        output_format = FileExportFormat.OBJ
        file_extension = "obj"
    else:
        raise ValueError("Invalid value for 'a'. Choose 1 for .stl, 2 for .step, or 3 for .obj.")

    # Prompt the API to generate a 3D model from text
    response = create_text_to_cad.sync(
        client=client,
        output_format=output_format,
        body=TextToCadCreateBody(
            prompt=prompt,
        ),
    )

    # Polling to check if the task is complete
    while response.completed_at is None:
        # Wait for 5 seconds before checking again
        time.sleep(5)

        # Check the status of the task
        response = get_text_to_cad_model_for_user.sync(
            client=client,
            id=response.id,
        )

    if response.status == ApiCallStatus.FAILED:
        # Print out the error message
        print(f"Text-to-CAD failed: {response.error}")

    elif response.status == ApiCallStatus.COMPLETED:
        # Print out the names of the generated files
        print(f"Text-to-CAD completed and returned {len(response.outputs)} files:")
        for name in response.outputs:
            print(f"  * {name}")

        # Save the data in the specified output directory
        final_result = response.outputs[f"source.{file_extension}"]
        output_file_path = os.path.join(output_dir, f"text-to-cad-output.{file_extension}")
        with open(output_file_path, "w", encoding="utf-8") as output_file:
            output_file.write(final_result.get_decoded().decode("utf-8"))
            print(f"Saved output to {output_file_path}")
else:
    print("Script execution is skipped as run_code is set to False.")
# ---------- end python_3_script ----------
python_3_script_2 = Python3Script(api=panel_3, path=file_path_2, prompt=panel_4, generate=Toggle(False))  # -> out, a, output_file_path
# ---------- python_3_script_2: Python ----------
import time
import os
import rhinoscriptsyntax as rs
import Rhino
import shutil
import scriptcontext as sc
from datetime import datetime

from kittycad.api.ai import create_text_to_cad, get_text_to_cad_model_for_user
from kittycad.client import Client
from kittycad.models.api_call_status import ApiCallStatus
from kittycad.models.file_export_format import FileExportFormat
from kittycad.models.text_to_cad_create_body import TextToCadCreateBody

# Set your API key directly in the code
API_KEY = api

# Create the client with the provided API key
client = Client(token=API_KEY)

# Define the output directory
output_dir = path

# Ensure the output directory exists
os.makedirs(output_dir, exist_ok=True)

# Set the variable 'a' to determine the output format
a = 2  # Change this value to 1, 2, or 3 to get .stl, .step, or .obj respectively

# Set the variable 'run_code' to control whether the script should run
run_code = generate  # Change this to False to skip running the script

if run_code:
    # Determine the output format based on the value of 'a'
    if a == 1:
        output_format = FileExportFormat.STL
        file_extension = "stl"
    elif a == 2:
        output_format = FileExportFormat.STEP
        file_extension = "step"
    elif a == 3:
        output_format = FileExportFormat.OBJ
        file_extension = "obj"
    else:
        raise ValueError("Invalid value for 'a'. Choose 1 for .stl, 2 for .step, or 3 for .obj.")

    # Prompt the API to generate a 3D model from text
    response = create_text_to_cad.sync(
        client=client,
        output_format=output_format,
        body=TextToCadCreateBody(
            prompt=prompt,
        ),
    )

    # Polling to check if the task is complete
    while response.completed_at is None:
        # Wait for 5 seconds before checking again
        time.sleep(5)

        # Check the status of the task
        response = get_text_to_cad_model_for_user.sync(
            client=client,
            id=response.id,
        )

    if response.status == ApiCallStatus.FAILED:
        # Print out the error message
        print(f"Text-to-CAD failed: {response.error}")

    elif response.status == ApiCallStatus.COMPLETED:
        # Print out the names of the generated files
        print(f"Text-to-CAD completed and returned {len(response.outputs)} files:")
        for name in response.outputs:
            print(f"  * {name}")

        # Save the data in the specified output directory
        final_result = response.outputs[f"source.{file_extension}"]
        output_file_path = os.path.join(output_dir, f"text-to-cad-output.{file_extension}")
        with open(output_file_path, "w", encoding="utf-8") as output_file:
            output_file.write(final_result.get_decoded().decode("utf-8"))
            print(f"Saved output to {output_file_path}")
else:
    print("Script execution is skipped as run_code is set to False.")



def import_step_file(step_file_path):
    """
    Import a STEP file into Rhino and return a list of object IDs.

    Parameters:
    step_file_path (str): The full path to the STEP file.

    Returns:
    list: A list of object IDs of the imported objects.
    """
    # Ensure the file path is a string
    if not isinstance(step_file_path, str):
        print("Invalid file path:", step_file_path)
        return []

    # Ensure the file exists
    if not os.path.exists(step_file_path):
        print("File does not exist:", step_file_path)
        return []

    # Import the STEP file
    rs.Command(f"_-Import \"{step_file_path}\" _Enter", False)

    # Add delay to ensure the import is complete
    time.sleep(2)  # Increased delay

    # Force a redraw to ensure objects are available
    sc.doc.Views.Redraw()

    # Get all objects in the document using RhinoCommon
    from Rhino.DocObjects import ObjectEnumeratorSettings

    settings = ObjectEnumeratorSettings()
    settings.IncludeLights = False
    settings.IncludeGrips = False
    settings.IncludeAnnotations = False
    settings.IncludeInstances = False
    settings.IncludeDetails = False
    settings.IncludeHatchPatterns = False
    settings.IncludeMeshes = False
    settings.IncludeCurves = False
    settings.IncludePoints = False
    settings.IncludeSurfaces = False
    settings.IncludeBrep = True  # Include Breps

    # Retrieve all objects
    imported_objects = list(Rhino.RhinoDoc.ActiveDoc.Objects.GetObjectList(settings))
    
    print(f"Found {len(imported_objects)} objects in the document.")

    # Hide the imported objects
    for obj in imported_objects:
        obj.Attributes.Visible = False
        obj.CommitChanges()  # Commit the visibility change

    return imported_objects

def get_breps_from_objects(object_list):
    """
    Get Brep objects from Rhino objects.

    Parameters:
    object_list (list): A list of Rhino objects.

    Returns:
    list: A list of Brep objects.
    """
    if object_list is None:
        return []

    breps = []
    for obj in object_list:
        if isinstance(obj.Geometry, Rhino.Geometry.Brep):
            breps.append(obj.Geometry)
        else:
            print(f"Object ID {obj.Id} is not a Brep, it is {type(obj.Geometry)}")
    return breps

def move_and_rename_file(step_file_path):
    """
    Move the STEP file to the 'MODELS' folder and rename it.

    Parameters:
    step_file_path (str): The full path to the STEP file.
    """
    # Get the directory where the STEP file is located
    main_directory = os.path.dirname(step_file_path)

    # Define the 'MODELS' folder path
    models_folder = os.path.join(main_directory, "MODELS")

    # Check if the 'MODELS' folder exists, if not, create it
    if not os.path.exists(models_folder):
        os.makedirs(models_folder)
        print(f"Created folder: {models_folder}")

    # Count the number of existing STEP files in the 'MODELS' folder
    existing_files = [f for f in os.listdir(models_folder) if f.endswith('.step') or f.endswith('.stp')]
    model_number = len(existing_files) + 1

    # Get the current date and time
    current_time = datetime.now().strftime("%Y-%m-%d_%H-%M")

    # Create the new file name
    file_name = f"model-{model_number}_{current_time}.step"

    # Define the destination path
    destination_path = os.path.join(models_folder, file_name)

    # Move and rename the STEP file
    shutil.move(step_file_path, destination_path)
    print(f"Moved and renamed file to: {destination_path}")

# Path to the STEP file from input
step_file_path = output_file_path

# Import the STEP file
imported_objects = import_step_file(step_file_path)

# Get Breps from imported objects
breps = get_breps_from_objects(imported_objects)

# Output Breps to Grasshopper
if breps:
    a = breps
    print(f"Output {len(breps)} Breps.")
else:
    a = "No Breps imported"
    print("No Breps were imported.")

# Move and rename the STEP file
move_and_rename_file(step_file_path)
# ---------- end python_3_script_2 ----------
panel_5 = Panel(python_3_script_2.output_file_path)
python_3_script_3 = Python3Script(x=python_3_script.output_file_path)  # -> out, a; disabled
# ---------- python_3_script_3: Python ----------
import rhinoscriptsyntax as rs
import Rhino
import os
import shutil
import scriptcontext as sc
import time
from datetime import datetime

def import_step_file(step_file_path):
    """
    Import a STEP file into Rhino and return a list of object IDs.

    Parameters:
    step_file_path (str): The full path to the STEP file.

    Returns:
    list: A list of object IDs of the imported objects.
    """
    # Ensure the file path is a string
    if not isinstance(step_file_path, str):
        print("Invalid file path:", step_file_path)
        return []

    # Ensure the file exists
    if not os.path.exists(step_file_path):
        print("File does not exist:", step_file_path)
        return []

    # Import the STEP file
    rs.Command(f"_-Import \"{step_file_path}\" _Enter", False)

    # Add delay to ensure the import is complete
    time.sleep(2)  # Increased delay

    # Force a redraw to ensure objects are available
    sc.doc.Views.Redraw()

    # Get all objects in the document using RhinoCommon
    from Rhino.DocObjects import ObjectEnumeratorSettings

    settings = ObjectEnumeratorSettings()
    settings.IncludeLights = False
    settings.IncludeGrips = False
    settings.IncludeAnnotations = False
    settings.IncludeInstances = False
    settings.IncludeDetails = False
    settings.IncludeHatchPatterns = False
    settings.IncludeMeshes = False
    settings.IncludeCurves = False
    settings.IncludePoints = False
    settings.IncludeSurfaces = False
    settings.IncludeBrep = True  # Include Breps

    # Retrieve all objects
    imported_objects = list(Rhino.RhinoDoc.ActiveDoc.Objects.GetObjectList(settings))
    
    print(f"Found {len(imported_objects)} objects in the document.")

    # Hide the imported objects
    for obj in imported_objects:
        obj.Attributes.Visible = False
        obj.CommitChanges()  # Commit the visibility change

    return imported_objects

def get_breps_from_objects(object_list):
    """
    Get Brep objects from Rhino objects.

    Parameters:
    object_list (list): A list of Rhino objects.

    Returns:
    list: A list of Brep objects.
    """
    if object_list is None:
        return []

    breps = []
    for obj in object_list:
        if isinstance(obj.Geometry, Rhino.Geometry.Brep):
            breps.append(obj.Geometry)
        else:
            print(f"Object ID {obj.Id} is not a Brep, it is {type(obj.Geometry)}")
    return breps

def move_and_rename_file(step_file_path):
    """
    Move the STEP file to the 'MODELS' folder and rename it.

    Parameters:
    step_file_path (str): The full path to the STEP file.
    """
    # Get the directory where the STEP file is located
    main_directory = os.path.dirname(step_file_path)

    # Define the 'MODELS' folder path
    models_folder = os.path.join(main_directory, "MODELS")

    # Check if the 'MODELS' folder exists, if not, create it
    if not os.path.exists(models_folder):
        os.makedirs(models_folder)
        print(f"Created folder: {models_folder}")

    # Count the number of existing STEP files in the 'MODELS' folder
    existing_files = [f for f in os.listdir(models_folder) if f.endswith('.step') or f.endswith('.stp')]
    model_number = len(existing_files) + 1

    # Get the current date and time
    current_time = datetime.now().strftime("%Y-%m-%d_%H-%M")

    # Create the new file name
    file_name = f"model-{model_number}_{current_time}.step"

    # Define the destination path
    destination_path = os.path.join(models_folder, file_name)

    # Move and rename the STEP file
    shutil.move(step_file_path, destination_path)
    print(f"Moved and renamed file to: {destination_path}")

# Path to the STEP file from input
step_file_path = x

# Import the STEP file
imported_objects = import_step_file(step_file_path)

# Get Breps from imported objects
breps = get_breps_from_objects(imported_objects)

# Output Breps to Grasshopper
if breps:
    a = breps
    print(f"Output {len(breps)} Breps.")
else:
    a = "No Breps imported"
    print("No Breps were imported.")

# Move and rename the STEP file
move_and_rename_file(step_file_path)
# ---------- end python_3_script_3 ----------
panel_6 = Panel(python_3_script.output_file_path)  # disabled
brep = Brep(python_3_script_3.a)  # disabled
custom_preview = CustomPreview(
    Geometry=python_3_script_2.a,
    Material={diffuse=RGB(228, 178, 227), emission=RGB(68, 53, 68), shine=0.5, specular=RGB(255, 254, 255), transparency=0})
python_3_script_4 = Python3Script()  # -> out, a
# ---------- python_3_script_4: Python ----------
# requirements: requests
import requests

# Step 1: Set up your API key and headers
api_key = "bd6b055b-416b-442b-a6c3-82435c74c684"  # Replace with your actual KittyCAD API key
headers = {
    "Authorization": f"Bearer {api_key}",
    "Content-Type": "application/json"
}

# Step 2: Load the 3D model file
model_path = "/Users/jorgemuyo/Desktop/STUFF/AI_3D_Models_Grasshopper/MODELS/model-1_2024-08-08_14-31.step"  # Replace with the actual path to your 3D model

# Step 3: Formulate the request data
with open(model_path, "rb") as model_file:
    model_data = model_file.read()

prompt = "Increase the height by 20%, smooth edges, and add a hole in the center."

# This example assumes that the API accepts JSON data; adjust if the API expects multipart/form-data
data = {
    "model": model_data.decode('latin-1'),  # Converting binary data to a string format for JSON compatibility
    "prompt": prompt
}

# Step 4: Define the URL for the KittyCAD API endpoint
url = "https://api.kittycad.io/v1/models/modify"  # Replace with the actual API endpoint

# Step 5: Make the API request to modify the 3D model
response = requests.post(url, headers=headers, json=data)

# Step 6: Handle the response
if response.status_code == 200:
    # Assuming the API returns the modified model as a file
    with open("modified_model.stl", "wb") as modified_model_file:
        modified_model_file.write(response.content)
    print("Model modified successfully. Saved as 'modified_model.stl'.")
else:
    print(f"Failed to modify model. Status code: {response.status_code}")
    print(f"Response: {response.text}")
# ---------- end python_3_script_4 ----------
